# Grasshopper definition Assginment_FinalSubmission.gh (Grasshopper 1.0.7)
# plug-ins: MeshEdit Components, Pufferfish, ICD.AbmFramework.Grasshopper, ScriptSync, Weaverbird, Human

# ---- group: NumAgents
number_slider = Slider(15, range=0..100)

# ---- group: SurfaceU1
number_slider_2 = Slider(10, range=0..30)

# ----
number_slider_3 = Slider(75, range=0..1000)

# ---- group: Behaviours
number_slider_4 = Slider(1, range=0..100)
number_slider_5 = Slider(10, range=0..1000)
D = Slider(10, range=0..10)
multiplication = Multiplication(A=number_slider_5, B="2")
define_containment_behavior = DefineContainmentBehavior(ContainmentDistance=D, Weight=1, Power=1)
boid_separate = DefineBoidSeparationBehavior(
    SeparationDistance=Slider(200, range=0..200),
    Weight=Slider(10, range=0..10),
    Power=Slider(5, range=0..10),
    AffectSelf=True)

# ----
viewrange = Slider(75, range=10..300)
viewrange_2 = Slider(6, range=1..10)
negative = Negative(Value=number_slider_3)

# ---- group: Behaviours / DigPileSwitch
c_script = CSharpScript(
    W=number_slider_4,
    DC=number_slider_5,
    PC=multiplication,
    iViewRange=viewrange,
    iViewHeight=viewrange_2,
    iActuationDistance="5",
    iStoppingDistance="3",
    iMaxSpeed="20",
    iDigLimit=negative,
    iPileLimit=number_slider_3,
    Reference="C:\USERS\MENGX\DROPBOX\ITECH\BEHAVIOURALFABRICATION\ICD.ABMFRAMEWORK-1.2.0\ICD.ABMFRAMEWORK-1.2.0\ICD.AbmFramework.Core.dll")  # -> out, oBehavior; inputs W: Double, DC: Int32, PC: Int32, iViewRange: Double, iViewHeight: Double, iActuationDistance: Double, iStoppingDistance: Double, iMaxSpeed: Double, iDigLimit: Double, iPileLimit: Double
# ---------- c_script: C# usings ----------
using ICD.AbmFramework.Core.Behavior;
using ICD.AbmFramework.Core.Agent;
using ICD.AbmFramework.Core.Environments;
using ICD.AbmFramework.Core.AgentSystem;
using System.Reflection;
using Rhino.Display;
using System.Drawing;
# ---------- c_script: C# ----------
    DigAndPileBehavior behavior = new DigAndPileBehavior(W, iViewRange, iViewHeight, iMaxSpeed, iStoppingDistance, iActuationDistance);
    behavior.DiggingCapacity = DC;
    behavior.PilingCap = PC;
    behavior.PilingLimit = iPileLimit;
    behavior.DiggingLimit = iDigLimit;
    oBehavior = behavior;
# ---------- c_script: C# additional code ----------
  public class DigAndPileBehavior : BehaviorBase
  {
    public int DiggingCapacity = 0;
    public int PilingCap = 0;

    public Point3d LowestPointLocation;
    public Point3d HighestPointLocation;
    public double botViewHeight;
    public double botViewRange;
    private AgentMode botMode = AgentMode.GoHigh; // AGENT MODE ASSIGNED HERE

    private double MaxSpeed;
    private double StoppingDistance;
    private double ActuationDistance;

    public double DiggingLimit = 0;
    public double PilingLimit = 0;

    public DigAndPileBehavior(double weight, double viewRange, double viewHeight, double newMaxSpeed, double newStoppingDistance, double newActuationDistance) : base()
    {
      Weight = weight;

      //OTHER PARAMETERS
      MaxSpeed = newMaxSpeed;
      StoppingDistance = newStoppingDistance;
      ActuationDistance = newActuationDistance;
      botViewRange = viewRange;
      botViewHeight = viewHeight;

    }

    public override void Execute(AgentBase agent)
    {
      Boid bot = (Boid) agent;
      BoidSystem aSys = (BoidSystem) agent.AgentSystem;
      MeshEnvironment mEnv = (MeshEnvironment) aSys.SurfEnvironment;
      Mesh envMesh = mEnv.Mesh;
      MeshPoint closestMeshPoint = envMesh.ClosestMeshPoint(bot.Position, 0.0);

      //======================================================================================================
      // Task: Compute the "force" vector caused by seeking HighestPoint
      //======================================================================================================


      int diggingStatus = (int) bot.CustomData["DiggingLoad"];
      Point3d location = bot.Position;


      var highLowPoints = FindHighLowPoints(bot, botViewHeight, botViewRange);
      HighestPointLocation = highLowPoints.Item1;
      LowestPointLocation = highLowPoints.Item2;

      //check if agent is at highest point

      bool atHighPoint = false;
      if (location.DistanceTo(HighestPointLocation) < ActuationDistance)
      {
        atHighPoint = true;
      }

      bool atLowestPoint = false;
      if (location.DistanceTo(LowestPointLocation) < ActuationDistance)
      {
        atLowestPoint = true;
      }

      switch (botMode) //MIGHT NEED A SLIGHT MODIFICATION.
      {
        case AgentMode.GoHigh:
          GotoHighestPoint(bot, MaxSpeed, StoppingDistance);
          if (atHighPoint)
          {
            botMode = AgentMode.Dig;
          }
          else if (diggingStatus >= DiggingCapacity)
          {
            botMode = AgentMode.GoLow;
          }

          break;

        case AgentMode.Dig:
          Dig(bot, diggingStatus);
          if (diggingStatus >= DiggingCapacity)
          {
            botMode = AgentMode.GoLow;
          }
          break;

        case AgentMode.GoLow:
          GotoLowestPoint(bot, MaxSpeed, StoppingDistance);
          if (atLowestPoint)
          {
            botMode = AgentMode.Pile;
          }
          else if (diggingStatus < DiggingCapacity)
          {
            botMode = AgentMode.GoHigh;
          }
          break;

        case AgentMode.Pile:
          Pile(bot, diggingStatus);
          if (diggingStatus == PilingCap)
          {
            agent.CustomData["DiggingLoad"] = 0;
          }
          if (diggingStatus < DiggingCapacity)
          {
            botMode = AgentMode.GoHigh;
          }

          break;

        default:
          break;
      }



    }

    public Tuple<Point3d, Point3d> FindHighLowPoints(Boid agent, double AgentViewHeight, double AgentViewRange)
    {
      //Get Access to the envMesh
      BoidSystem aSys = (BoidSystem) agent.AgentSystem;
      MeshEnvironment mEnv = (MeshEnvironment) aSys.SurfEnvironment;
      Mesh envMesh = mEnv.Mesh;
      Point3d myAgentViewPoint = agent.Position;
      double myAgentViewrange = (double) AgentViewRange;
      Point3d highestPoint = new Point3d();
      Point3d lowestPoint = new Point3d();

      //Add view height parameter
      myAgentViewPoint.Z = (double) myAgentViewPoint.Z + AgentViewHeight;
      //Main List for outputs
      List<double> vertexIndexes = new List<double>();

      //Highest and lowest point index
      bool firstCheck = true;
      int highestVertexIndex = 0;
      double highestVertexHeight = 0;
      int lowestVertexIndex = 0;
      double lowestVertexHeight = 0;
      //Optional Lists for Heavy Outputs
      List<Vector3d> viewVectors = new List<Vector3d>();
      List<Point3d> viewPoints = new List<Point3d>();

      for (int i = 0; i < envMesh.Vertices.Count; i++)
      {
        //1. Visit the mesh vertex
        Point3d currentVertex = envMesh.Vertices[i];

        //2. Create vector from agent position to vertex
        Vector3d viewVector = currentVertex - myAgentViewPoint;

        //BREAKPOINT TO CONSIDER ONLY VECTORS IN RANGE OF VIEW
        double vectorLength = viewVector.Length;
        if (vectorLength < myAgentViewrange)
        {
          //3. Create ray from agent position to vertex
          Ray3d viewRay = new Ray3d(myAgentViewPoint, viewVector);

          //4. Create MeshRay from ray
          double viewMeshRay = Rhino.Geometry.Intersect.Intersection.MeshRay(envMesh, viewRay);

          //LAST, add info to lists
          //Check visibility = ray is hitting a visible spot, in other words, exactly or around parameter 1.0 in the MeshRay result

          if (viewMeshRay >= 0.99 && viewMeshRay <= 1.01)
          {
            //0. Get the index of the mesh vertex
            int vertexIndex = i;

            //X. Fill lists with visible data
            vertexIndexes.Add(vertexIndex);
            viewVectors.Add(viewVector);
            viewPoints.Add(currentVertex);

            //Check for highest or lowest cases
            if (firstCheck == true)
            {
              //Turn off check
              firstCheck = false;
              //Assign highest and lowest for the first time
              highestVertexHeight = currentVertex.Z;
              lowestVertexHeight = currentVertex.Z;
            }
              //Assign highest and lowest for the remaining checks
            else
            {
              if (currentVertex.Z > highestVertexHeight)
              {
                highestVertexIndex = vertexIndex;
                highestVertexHeight = currentVertex.Z;
                highestPoint = envMesh.Vertices[highestVertexIndex];
                //return highestPoint;
              }

              if (currentVertex.Z < lowestVertexHeight)
              {
                lowestVertexIndex = vertexIndex;
                lowestVertexHeight = currentVertex.Z;
                lowestPoint = envMesh.Vertices[lowestVertexIndex];
              }

            }
          }
        }
      }
      agent.CustomData["LowestVertices"] = lowestPoint;
      agent.CustomData["HighestVertices"] = highestPoint;
      return new Tuple<Point3d, Point3d>(highestPoint, lowestPoint);

    }

    public void GotoHighestPoint(Boid agent, double maxSpeed, double stoppingDistance)
    {
      Point3d location = agent.Position;
      var highLowPoints = FindHighLowPoints(agent, botViewHeight, botViewRange);
      HighestPointLocation = highLowPoints.Item1;

      Vector3d newDir = HighestPointLocation - location;
      //========================================================
      // ADDITION: LIMIT SPEED
      //========================================================
      double distance = newDir.Length;
      newDir.Unitize();
      newDir *= maxSpeed; //THIS IS THE MAX SPEED
      //========================================================
      // ADDITION: SMOOTHLY STOP WHEN CLOSE TO THE HIGHEST POINT
      //========================================================
      double minStoppingDistance = stoppingDistance; //THIS IS THE MIN STOPPING DISTANCE
      if (distance < minStoppingDistance)
      {
        newDir.Unitize();
        double multFactor = minStoppingDistance - ((minStoppingDistance - distance) * (minStoppingDistance - distance)); //FACTORING TO STOP SMOOTHLY
        newDir *= multFactor;
      }
      agent.Velocity = newDir;
    }

    public void GotoLowestPoint(Boid agent, double maxSpeed, double stoppingDistance)
    {
      Point3d location = agent.Position;
      var highLowPoints = FindHighLowPoints(agent, botViewHeight, botViewRange);
      LowestPointLocation = highLowPoints.Item2;

      Vector3d newDir = LowestPointLocation - location;
      //========================================================
      // ADDITION: LIMIT SPEED
      //========================================================
      double distance = newDir.Length;
      newDir.Unitize();
      newDir *= maxSpeed; //THIS IS THE MAX SPEED
      //========================================================
      // ADDITION: SMOOTHLY STOP WHEN CLOSE TO THE HIGHEST POINT
      //========================================================
      double minStoppingDistance = stoppingDistance; //THIS IS THE MIN STOPPING DISTANCE
      if (distance < minStoppingDistance)
      {
        newDir.Unitize();
        double multFactor = minStoppingDistance - ((minStoppingDistance - distance) * (minStoppingDistance - distance)); //FACTORING TO STOP SMOOTHLY
        newDir *= multFactor;
      }
      agent.Velocity = newDir;

    }

    public void Pile(Boid agent, int diggingStatus)
    {
      //Boid boid = agent as Boid;
      BoidSystem aSys = (BoidSystem) agent.AgentSystem;
      MeshEnvironment mEnv = (MeshEnvironment) aSys.SurfEnvironment;
      Mesh envMesh = mEnv.Mesh;

      MeshPoint closestMeshPoint = envMesh.ClosestMeshPoint(agent.Position, 0.0);
      int faceIx = closestMeshPoint.FaceIndex;
      int[] vertices = envMesh.Faces.GetTopologicalVertices(faceIx);

      
      foreach (int index in vertices)
      {
        Point3f vPt = envMesh.Vertices[index];
        if (vPt.Z < this.PilingLimit)
        {
          Transform xform = Transform.Translation(0, 0, 1 * Weight);
          vPt.Transform(xform);
          envMesh.Vertices[index] = vPt;
        }
      }
      diggingStatus -= 1; //QUESTION, WAS THIS MEANT TO STAY IN += 1
      agent.CustomData["DiggingLoad"] = diggingStatus;
      agent.Position = closestMeshPoint.Point;
    }

    public void Dig(Boid agent, int diggingStatus)
    {
      //Boid boid = agent as Boid;
      BoidSystem aSys = (BoidSystem) agent.AgentSystem;
      MeshEnvironment mEnv = (MeshEnvironment) aSys.SurfEnvironment;
      Mesh envMesh = mEnv.Mesh;

      MeshPoint closestMeshPoint = envMesh.ClosestMeshPoint(agent.Position, 0.0);
      int faceIx = closestMeshPoint.FaceIndex;
      int[] vertices = envMesh.Faces.GetTopologicalVertices(faceIx);


      foreach (int index in vertices)
      {
        Point3f vPt = envMesh.Vertices[index];

        if (vPt.Z > this.DiggingLimit)
        {
          Transform xform = Transform.Translation(0, 0, -1 * Weight);
          vPt.Transform(xform);
          envMesh.Vertices[index] = vPt;
        }

      }
      diggingStatus += 1;
      agent.CustomData["DiggingLoad"] = diggingStatus;
      agent.Position = closestMeshPoint.Point;
    }

    public enum AgentMode
    {
      GoHigh,
      GoLow,
      Dig,
      Pile
    }
  }
# ---------- end c_script ----------

# ----
larger_than = LargerThan(FirstNumber=Slider(1, range=1..100), SecondNumber="1")  # -> LargerThan, OrEqualTo

# ----
# MeshMaker
construct_point = ConstructPoint(XCoordinate=0, YCoordinate=0, ZCoordinate=0)
number_slider_6 = Slider(70, range=0..300)
number_slider_7 = Slider(64, range=0..100)
topography_variation = Slider(221, range=1..1000)
roughness = Slider(23, range=0..200)
# MAIN SCRIPT
number_slider_8 = Slider(11, range=0..20)

# ---- group: Agent Initial Parameters
view_height = Panel(viewrange_2)
scriptsync = ScriptSync(targetScriptComponentGuid=c_script_3)

# ---- group: Define Environment
# OLD
scriptsync_2 = ScriptSync(targetScriptComponentGuid=c_script_2)

# ----
rectangle = Rectangle(Plane=PlaneXY(0, 0, 0), XSize=number_slider_6, YSize=number_slider_6, Radius=0)  # -> Rectangle, Length
rectangular_array = RectangularArray(Geometry=construct_point, Cell=rectangle.Rectangle, XCount=number_slider_2, YCount=number_slider_2)  # -> Geometry, Transform
cluster = Cluster(
    list=rectangular_array.Geometry,
    domain_start="0",
    geometry=rectangular_array.Geometry,
    domain_end=topography_variation,
    seed=Slider(1, range=0..10))
surface_from_points = SurfaceFromPoints(Points=cluster, UCount=number_slider_2, Interpolate=False)
bounding_box = BoundingBox(Content=surface_from_points, Plane=PlaneXY(0, 0, 0))  # -> Box, Box_2
# SETUP
deconstruct_box = DeconstructBox(Box=bounding_box.Box)  # -> Plane, X, Y, Z
range = Range(Domain=deconstruct_box.X, Steps=number_slider_7)
range_2 = Range(Domain=deconstruct_box.Y, Steps=number_slider_7)
construct_point_2 = ConstructPoint(XCoordinate=range, YCoordinate=graft(range_2), ZCoordinate=0)
unit_z = UnitZ(Factor=1)
project_point = ProjectPoint(Point=construct_point_2, Direction=unit_z, Geometry=surface_from_points)  # -> simplify(Point), Index
flatten_tree = FlattenTree(Tree=project_point.Point, Path="{0}")
cluster_2 = Cluster(list=flatten_tree, domain_start="0", geometry=flatten_tree, domain_end=roughness, seed=2)
mesh_frompoints = MeshFromPoints(Points=cluster_2, UDirection=expr("x+1", number_slider_7), VDirection=expr("x+1", number_slider_7))

mesh_triangulate = MeshTriangulate(Mesh=mesh_frompoints, ShortDiagonal=True)

smooth_mesh = SmoothMesh(Mesh=mesh_triangulate, Strength="0.5", SkipNaked=True, Iterations=1)
mesh = Mesh(smooth_mesh)

mesh_2 = Mesh(mesh)
deconstruct_mesh = DeconstructMesh(Mesh=mesh_2)  # -> Vertices, Faces, Colours, Normals
construct_point_3 = ConstructPoint(XCoordinate=0, YCoordinate=0, ZCoordinate=0)
list_item = ListItem(List=deconstruct_mesh.Vertices, Index=0, Wrap=True)
move_to_point = MoveToPoint(Geometry=mesh_2, PointA=list_item, PointB=construct_point_3)  # -> Moved, Vector, Transform

# ---- group: StartingMesh
mesh_3 = Mesh(flatten(move_to_point.Moved))

# ---- group: Define Environment / StartingMesh
mesh_4 = Mesh(mesh_3)

# ---- group: Define Environment (continued)
c_script_2 = CSharpScript(
    iMesh=mesh_4,
    Reference="C:\Users\mengx\Dropbox\ITECH\behaviouralFabrication\ICD.AbmFramework-1.2.0\ICD.AbmFramework-1.2.0\ICD.AbmFramework.Core.dll")  # -> out, oEnvironment; inputs iMesh: Mesh
# ---------- c_script_2: C# usings ----------
using System.IO;
using System.Linq;
using System.Data;
using System.Drawing;
using System.Reflection;
using System.Windows.Forms;
using System.Xml;
using System.Xml.Linq;
using System.Runtime.InteropServices;

using Rhino.DocObjects;
using Rhino.Collections;
using GH_IO;
using GH_IO.Serialization;
using ICD.AbmFramework.Core;
using ICD.AbmFramework.Core.Utilities;
using ICD.AbmFramework.Core.Environments;
using ICD.AbmFramework.Core.Behavior;
using ICD.AbmFramework.Core.Agent;
using ICD.AbmFramework.Core.AgentSystem;
# ---------- c_script_2: C# ----------
        oEnvironment = new MeshEnvironment(iMesh);
# ---------- end c_script_2 ----------

# ---- group: Agent Initial Parameters (continued)
deconstruct_mesh_2 = DeconstructMesh(Mesh=mesh_4)  # -> Vertices, Faces, Colours, Normals

# ----
# AgentMaker
deconstruct_mesh_3 = DeconstructMesh(Mesh=mesh_3)  # -> Vertices, Faces, Colours, Normals

list_length = ListLength(List=deconstruct_mesh_3.Vertices)

random = Random(Range=list_length, Number=number_slider, Seed=number_slider_8)
round = Round(Number=random)  # -> Nearest, Floor, Ceiling
list_item_2 = ListItem(List=deconstruct_mesh_3.Vertices, Index=round.Nearest, Wrap=True)

# ---- group: AgentStartingPoints
point = Point(list_item_2)

# ---- group: Agent Initial Parameters / RobotAgentsInit
point_2 = Point(point)

# ---- group: Agent Initial Parameters (continued)
list_length_2 = ListLength(List=point_2)
repeat_data = RepeatData(Data=view_height, Length=list_length_2)
repeat_data_2 = RepeatData(Data=viewrange, Length=list_length_2)
c_script_3 = CSharpScript(
    iMesh=mesh_4,
    iCount=list_length_2,
    iAgentPoint=point_2,
    iAgentViewHeight=repeat_data,
    iAgentViewRange=repeat_data_2,
    iSeed=Slider(4, range=0..10))  # -> out, simplify(oVel), oHighestVerticesIndex, oLowestVerticesIndex, oVisibleVerticesIndex, oViewPoints; inputs iMesh: Mesh, iCount: Int32, iAgentPoint: list of Point3d, iAgentViewHeight: list of Double, iAgentViewRange: list of Double, iSeed: Int32
# ---------- c_script_3: C# ----------
        List<Vector3d> velocities = new List<Vector3d>();
        Random random = new Random(iSeed);
        double theta = 0;
        double radius = 10;
        //EMPTY VISIBILITIES LIST
        List<VisibleVertex> visibilityList = new List<VisibleVertex>();
        //Set velocities

        for (int i = 0; i < iCount; i++)
        {
            theta = random.NextDouble() * 2 * Math.PI;
            velocities.Add(new Vector3d(
                radius * Math.Cos(theta),
                radius * Math.Sin(theta),
                0));
        }

        // Run Visibilities
        for (var i = 0; i < iCount; i++)
        {
            VisibleVertex visibility = new VisibleVertex(iMesh, iAgentPoint[i], iAgentViewHeight[i], iAgentViewRange[i]);
            visibility.Compute(false);
            visibilityList.Add(visibility);
        }
        //PRE-OUTPUT GRASSHOPPER TREES
        DataTree<Point3d> viewPoints = new DataTree<Point3d>();
        DataTree<int> visibleVerticesIndex = new DataTree<int>();
        DataTree<int> highestVerticesIndex = new DataTree<int>();
        DataTree<int> lowestVerticesIndex = new DataTree<int>();

        // Append visibilities lists to Pre-output tree paths

        for (var i = 0; i < visibilityList.Count; i++)
        {
            //view points
            GH_Path pth = new GH_Path(i);
            viewPoints.Add(visibilityList[i].AgentViewPoint, pth);
            //Assign remaining lists to paths
            foreach (int index in visibilityList[i].VisibleVertexIndexes)
            {
                visibleVerticesIndex.Add(index, pth);
            }
            foreach (int index in visibilityList[i].HighestVertexIndexes)
            {
                highestVerticesIndex.Add(index, pth);
            }
            foreach (int index in visibilityList[i].LowestVertexIndexes)
            {
                lowestVerticesIndex.Add(index, pth);
            }
        }

        //ASSIGN PRE-OUTPUT TREES TO OUTPUT PORTS
        oVel = velocities;
        oViewPoints = viewPoints;
        oVisibleVerticesIndex = visibleVerticesIndex;
        oHighestVerticesIndex = highestVerticesIndex;
        oLowestVerticesIndex = lowestVerticesIndex;
# ---------- c_script_3: C# additional code ----------
    class VisibleVertex
    {
        //Main attribuites
        public Mesh EnvironmentMesh;
        public Point3d AgentViewPoint;
        public double AgentViewRange;

        public List<Point3d> VisibleVertexPoints = new List<Point3d>();
        public List<Vector3d> ViewVectors = new List<Vector3d>();
        public List<int> VisibleVertexIndexes = new List<int>();
        public List<int> HighestVertexIndexes = new List<int>();
        public List<int> LowestVertexIndexes = new List<int>();


        //CONSTRUCTOR (Input mesh, agent location point, agent view height, agent view range)
        public VisibleVertex(Mesh environmentMesh, Point3d agentPoint, double viewHeight, double viewRange)
        {
            EnvironmentMesh = environmentMesh;
            agentPoint.Z += viewHeight; // to assign height to agent
            AgentViewPoint = agentPoint;
            AgentViewRange = viewRange;
        }

        //COMPUTE Function. true if visible points should be saved
        public void Compute(bool computePoints)
        {

            //Boolean for final loop
            bool firstCheck = true;

            //Highest and Lowest counter
            List<double> highestVertexHeights = new List<double>();
            List<double> lowestVertexHeights = new List<double>();

            for (int i = 0; i < EnvironmentMesh.Vertices.Count; i++)
            {
                //1. Visit the mesh vertex
                Point3d currentVertex = EnvironmentMesh.Vertices[i];

                //FILTER. To only operate on vectors with x, y, z ranges for robustness.
                if (currentVertex.X < AgentViewPoint.X + AgentViewRange && currentVertex.X > AgentViewPoint.X - AgentViewRange)
                {
                    if (currentVertex.Y < AgentViewPoint.Y + AgentViewRange && currentVertex.Y > AgentViewPoint.Y - AgentViewRange)
                    {

                        if (currentVertex.Z < AgentViewPoint.Z + AgentViewRange && currentVertex.Z > AgentViewPoint.Z - AgentViewRange)
                        {
                            //CONTINUE AFTER FILTER
                            //2. Create vector from agent position to vertex
                            Vector3d viewVector = currentVertex - AgentViewPoint;

                            //FILTER TO ONLY OPERATE ON VERTICES IN REAL RANGE OF VIEW
                            double vectorLength = viewVector.Length;
                            if (vectorLength < AgentViewRange)
                            {
                                //3. Create ray from agent position to vertex
                                Ray3d viewRay = new Ray3d(AgentViewPoint, viewVector);

                                //4. Create MeshRay from ray
                                double viewMeshRay = Rhino.Geometry.Intersect.Intersection.MeshRay(EnvironmentMesh, viewRay);

                                //LAST, add info to lists
                                //Check visibility = ray is hitting a visible spot, in other words, exactly or around parameter 1.0 in the MeshRay result

                                if (viewMeshRay >= 0.99 && viewMeshRay <= 1.01)
                                {
                                    //0. Get the index of the mesh vertex
                                    int vertexIndex = i;

                                    //X. Fill lists with visible data
                                    VisibleVertexIndexes.Add(vertexIndex);
                                    ViewVectors.Add(viewVector);

                                    if (computePoints == true)
                                        VisibleVertexPoints.Add(currentVertex);

                                    //MAIN EVALUATION - Check for highest or lowest cases
                                    if (firstCheck == true) //This will run only in the first iteration
                                    {
                                        //Turn off first check
                                        firstCheck = false;

                                        //Assign highest and lowest for the first time
                                        HighestVertexIndexes.Add(vertexIndex);
                                        highestVertexHeights.Add(currentVertex.Z);

                                        LowestVertexIndexes.Add(vertexIndex);
                                        lowestVertexHeights.Add(currentVertex.Z);
                                    }
                                    //Assign highest and lowest point and index for the remaining checks
                                    else
                                    {
                                        if (currentVertex.Z > highestVertexHeights[0])
                                        {
                                            HighestVertexIndexes[0] = vertexIndex;
                                            highestVertexHeights[0] = currentVertex.Z;
                                        }

                                        if (currentVertex.Z < lowestVertexHeights[0])
                                        {
                                            LowestVertexIndexes[0] = vertexIndex;
                                            lowestVertexHeights[0] = currentVertex.Z;
                                        }
                                    }
                                }
                            }
                        }
                    }
                }
            }
        }
    }
# ---------- end c_script_3 ----------
list_item_3 = ListItem(List=deconstruct_mesh_2.Vertices, Index=c_script_3.oHighestVerticesIndex, Wrap=True)  # -> flatten(Item)
list_item_4 = ListItem(List=deconstruct_mesh_2.Vertices, Index=c_script_3.oLowestVerticesIndex, Wrap=True)  # -> flatten(Item)

# ----
list_item_5 = ListItem(List=point_2, Index=0, Wrap=True)

# ---- group: Behaviours / Add new bots
c_script_4 = CSharpScript(
    iProb=Slider(0.01, range=0..0.01),
    iPoint=list_item_5,
    Reference="C:\USERS\MENGX\DROPBOX\ITECH\BEHAVIOURALFABRICATION\ICD.ABMFRAMEWORK-1.2.0\ICD.ABMFRAMEWORK-1.2.0\ICD.AbmFramework.Core.dll")  # -> out, oBehavior; inputs iBounds: Curve, iProb: Double, iPoint: Point3d
# ---------- c_script_4: C# usings ----------
using ICD.AbmFramework.Core;
using ICD.AbmFramework.Core.Agent;
using ICD.AbmFramework.Core.AgentSystem;
using ICD.AbmFramework.Core.Behavior;
using ICD.AbmFramework.Core.Environments;
# ---------- c_script_4: C# ----------
    behavior.Bounds = iBounds;
    behavior.Probability = iProb;
    behavior.StartingPoint = iPoint;
    behavior.Max = 100;
    oBehavior = behavior;
# ---------- c_script_4: C# additional code ----------
  AddFoodBehavior behavior = new AddFoodBehavior(0.01);


  public class AddFoodBehavior : BehaviorBase
  {
    public Curve Bounds;
    public double Probability;
    public int Max;
    public Point3d StartingPoint = new Point3d();
    private static Random random = new Random();

    public AddFoodBehavior(double weight)
    {
      Weight = weight;
    }

    public override void Execute(AgentBase agent)
    {
            
      Boid boid = agent as Boid;
      BoidSystem boidSystem = boid.AgentSystem as BoidSystem;
      if (random.NextDouble() > Probability || boidSystem.Agents.Count >= Max) return;

      Point3d newAgentPosition = StartingPoint;
      List<BehaviorBase> newAgentBehaviors = boid.Behaviors; // the new agent has the same behaviors as other original agent
      Boid newAgent = new Boid(newAgentPosition, boid.Velocity, newAgentBehaviors);

         

      boidSystem.AddAgent(newAgent);

    }





  }
# ---------- end c_script_4 ----------

# ---- group: Agent Initial Parameters / HighestPointsList
point_3 = Point(list_item_3)

# ---- group: Agent Initial Parameters / LowestPointsList
point_4 = Point(list_item_4)

# ---- group: Defining Agents
c_script_5 = CSharpScript(
    iPositions=point_2,
    iVelocities=c_script_3.oVel,
    iHighVerticies=point_3,
    iLowVerticies=point_4,
    iBehaviors=[boid_separate, define_containment_behavior, c_script.oBehavior],
    Reference="C:\USERS\MENGX\DROPBOX\ITECH\BEHAVIOURALFABRICATION\ICD.ABMFRAMEWORK-1.2.0\ICD.ABMFRAMEWORK-1.2.0\ICD.AbmFramework.Core.dll")  # -> out, oAgent; inputs iPositions: list of Point3d, iVelocities: list of Vector3d, iHighVerticies: list of Point3d, iLowVerticies: list of Point3d, iBehaviors: list
# ---------- c_script_5: C# usings ----------
using Rhino.DocObjects;
using Rhino.Collections;
using GH_IO;
using GH_IO.Serialization;
using ICD.AbmFramework.Core;
using ICD.AbmFramework.Core.Utilities;
using ICD.AbmFramework.Core.Environments;
using ICD.AbmFramework.Core.Behavior;
using ICD.AbmFramework.Core.Agent;
using ICD.AbmFramework.Core.AgentSystem;
# ---------- c_script_5: C# ----------
        List<BehaviorBase> behaviors = new List<BehaviorBase>();
        foreach (BehaviorBase behavior in iBehaviors)
        {
            behaviors.Add(behavior);
        }
        List<Boid> agents = new List<Boid>();
        for (int i = 0; i< iVelocities.Count; i++)
        {
            Boid b = new Boid(iPositions[i], iVelocities[i], behaviors);
            b.CustomData.Add("HighestVertices", iHighVerticies[i]);
            b.CustomData.Add("LowestVertices", iLowVerticies[i]);
            agents.Add(b);
        }
        oAgent = agents;
# ---------- end c_script_5 ----------
scriptsync_3 = ScriptSync(targetScriptComponentGuid=c_script_5)

# ---- group: AGENT SYSTEM
# Piling agent, no Higher/Lower vertices input. Low priority
panel = Panel("0.1")

# ---- group: SOLVER
button = Button()

# ---- group: Behaviours / Bot Break
c_script_6 = CSharpScript(
    iReset=button,
    iDigLimit=negative,
    iPileLimit=number_slider_3,
    Reference="C:\USERS\MENGX\DROPBOX\ITECH\BEHAVIOURALFABRICATION\ICD.ABMFRAMEWORK-1.2.0\ICD.ABMFRAMEWORK-1.2.0\ICD.AbmFramework.Core.dll")  # -> out, oBehavior; inputs iReset: Boolean, iDigLimit: Double, iPileLimit: Double
# ---------- c_script_6: C# ----------
    RemoveAgentBehavior behavior = new RemoveAgentBehavior();
    behavior.pileLimit = iPileLimit;
    behavior.digLimit = iDigLimit;
    oBehavior = behavior;
# ---------- c_script_6: C# additional code ----------
  public class RemoveAgentBehavior: BehaviorBase
  {

    public double digLimit = 0;
    public double pileLimit = 0;

    public RemoveAgentBehavior ():base()
    {
      Weight = 1.0;
    }

    public override void Execute (AgentBase agent)
    {
      Boid boid = agent as Boid;
      BoidSystem boidSystem = boid.AgentSystem as BoidSystem;
      Point3d location = boid.Position;
      double zHeight = location.Z;
      double zD = Math.Abs(zHeight - digLimit);
      double zDP = Math.Abs(zHeight - pileLimit);
      if (zD < 5 || zDP<5 || (Vector3d) boid.Velocity == new Vector3d(0, 0, 0) || boid.IsFixed)
      {
        boidSystem.RemoveAgent(boid);
        return;
      }
      return;
    }
  }
# ---------- end c_script_6 ----------

# ---- group: AGENT SYSTEM / Agent Reset
c_script_7 = CSharpScript(
    iReset=button,
    iAgents=c_script_5.oAgent,
    Reference="C:\USERS\MENGX\DROPBOX\ITECH\BEHAVIOURALFABRICATION\ICD.ABMFRAMEWORK-1.2.0\ICD.ABMFRAMEWORK-1.2.0\ICD.AbmFramework.Core.dll")  # -> out, A; inputs iReset: Boolean, iAgents: list, iBattery: Int32
# ---------- c_script_7: C# usings ----------
using ICD.AbmFramework.Core.Agent;
# ---------- c_script_7: C# ----------
    foreach(Boid agent in iAgents)
    {
      if(!agent.CustomData.ContainsKey("Battery"))
      {
        agent.CustomData.Add("Battery", iBattery);
      }
      if(agent.CustomData["Battery"] == null || iReset)
      {
        agent.CustomData["Battery"] = iBattery;
      }

      if(!agent.CustomData.ContainsKey("Charging"))
      {
        agent.CustomData.Add("Charging", false);
      }
      if(agent.CustomData["Charging"] == null || iReset)
      {
        agent.CustomData["Charging"] = false;
      }

      if(!agent.CustomData.ContainsKey("NeedsToCharge"))
      {
        agent.CustomData.Add("NeedsToCharge", false);
      }
      if(agent.CustomData["NeedsToCharge"] == null || iReset)
      {
        agent.CustomData["NeedsToCharge"] = false;
      }

      if(!agent.CustomData.ContainsKey("DiggingLoad"))
      {
        agent.CustomData.Add("DiggingLoad", 0);
      }
      if(agent.CustomData["DiggingLoad"] == null || iReset)
      {
        agent.CustomData["DiggingLoad"] = 0;
      }

      if(!agent.CustomData.ContainsKey("Digging"))
      {
        agent.CustomData.Add("Digging", false);
      }
      if(agent.CustomData["Digging"] == null || iReset)
      {
        agent.CustomData["Digging"] = false;
      }
      
      if(!agent.CustomData.ContainsKey("Piling"))
      {
        agent.CustomData.Add("Piling", false);
      }
      if(agent.CustomData["Piling"] == null || iReset)
      {
        agent.CustomData["Piling"] = false;
      }


    }
    A = iAgents;
# ---------- end c_script_7 ----------

# ---- group: AGENT SYSTEM (continued)
define_boid_system = DefineBoidSystem(
    SurfaceEnvironment=c_script_2.oEnvironment,
    BoidAgents=flatten(c_script_7.A),
    DisplacementThreshold="0.001",
    Timestep=panel,
    MaxForce="30",
    MaxSpeed="30")

# ----
silent_solver = SilentSolver(Execute=False, AgentSystems=define_boid_system, MaxIterationCount="500")  # -> DisplayGeometries, AllAgentSystems, IterationCount; disabled

# ---- group: SOLVER (continued)
solver = StepByStepSolver(Reset=button, Execute=larger_than.LargerThan, AgentSystems=define_boid_system)  # -> DisplayGeometries, AllAgentSystems, IterationCount

# ---- group: visualization
dispatch = Dispatch(List=solver.DisplayGeometries, DispatchPattern=[True, False])  # -> ListA, ListB
vdis = VectorDisplay(Anchor=dispatch.ListA, Vector=dispatch.ListB)

# ----
c_script_8 = CSharpScript(
    ASys=solver.AllAgentSystems,
    Reference="C:\USERS\MENGX\DROPBOX\ITECH\BEHAVIOURALFABRICATION\ICD.ABMFRAMEWORK-1.2.0\ICD.ABMFRAMEWORK-1.2.0\ICD.AbmFramework.Core.dll")  # -> out, A
# ---------- c_script_8: C# usings ----------
using ICD.AbmFramework.Core.AgentSystem;
using ICD.AbmFramework.Core.Environments;
# ---------- c_script_8: C# ----------
    BoidSystem mySystem = (BoidSystem) ASys;
    MeshEnvironment myEnv = (MeshEnvironment) mySystem.SurfEnvironment;
    Mesh myMesh = myEnv.Mesh;


    A = myMesh;
# ---------- end c_script_8 ----------
demesh = DeconstructMesh(Mesh=c_script_8.A)  # -> Vertices, Faces, Colours, Normals
pdecon = Deconstruct(Point=demesh.Vertices)  # -> XComponent, YComponent, ZComponent
remap = RemapNumbers(Value=pdecon.ZComponent, Source="-400 to 250", Target=Domain(0, 1))  # -> Mapped, Clipped
pt = ConstructPoint(XCoordinate=remap.Mapped, YCoordinate=0, ZCoordinate=0)

# ---- group: View around and detect highest mesh face. NOTE: REQUIRES SAME AMOUNT OF INPUTS FOR Agent points, height and range
c_script_9 = CSharpScript(iEnvironmentMesh=c_script_8.A, iAgentPoint=dispatch.ListA, iAgentViewHeight=repeat_data, iAgentViewRange=repeat_data_2)  # -> out, oViewPoints, oVisibleVertexPoints, oViewVectors, oVisibleVerticesIndex, oHighestVerticesIndex, oLowestVerticesIndex; inputs iEnvironmentMesh: Mesh, iAgentPoint: list of Point3d, iAgentViewHeight: list of Double, iAgentViewRange: list of Double
# ---------- c_script_9: C# ----------
        //EMPTY VISIBILITIES LIST
        List<VisibleVertex> visibilityList = new List<VisibleVertex>();
        
        //RUN VISIBILITIES
        for (var i = 0; i < iAgentPoint.Count; i++)
            {
            VisibleVertex visibility = new VisibleVertex(iEnvironmentMesh, iAgentPoint[i], iAgentViewHeight[i], iAgentViewRange[i]);
            visibility.Compute(false);
            visibilityList.Add(visibility);
            }

        //PRE-OUTPUT GRASSHOPPER TREES
        DataTree<Point3d> viewPoints = new DataTree<Point3d>();
        DataTree<Point3d> visibleVertexPoints = new DataTree<Point3d>();
        DataTree<Vector3d> viewVectors = new DataTree<Vector3d>();
        DataTree<int> visibleVerticesIndex = new DataTree<int>();
        DataTree<int> highestVerticesIndex = new DataTree<int>();
        DataTree<int> lowestVerticesIndex = new DataTree<int>();


        //APPEND VISIBILITIES LISTS TO PRE-OUTPUT TREE PATHS
        for(var i = 0;i < visibilityList.Count;i++)
            {
            //View points
            GH_Path pth = new GH_Path(i);
            viewPoints.Add(visibilityList[i].AgentViewPoint, pth);
            
            //Assign remaining lists to paths
            foreach(Point3d point in visibilityList[i].VisibleVertexPoints)
                {
                visibleVertexPoints.Add(point, pth);
                }
            foreach (Vector3d vector in visibilityList[i].ViewVectors)
                {
                viewVectors.Add(vector, pth);
                }
            foreach (int index in visibilityList[i].VisibleVertexIndexes)
                {
                visibleVerticesIndex.Add(index, pth);
                }
            foreach (int index in visibilityList[i].HighestVertexIndexes)
                {
                highestVerticesIndex.Add(index, pth);
                }
            foreach (int index in visibilityList[i].LowestVertexIndexes)
                {
                lowestVerticesIndex.Add(index, pth);
                }
        }

        //ASSIGN PRE-OUTPUT TREES TO OUTPUT PORTS
        oViewPoints = viewPoints;
        oVisibleVertexPoints = visibleVertexPoints;
        oViewVectors = viewVectors;
        oVisibleVerticesIndex = visibleVerticesIndex;
        oHighestVerticesIndex = highestVerticesIndex;
        oLowestVerticesIndex = lowestVerticesIndex;
# ---------- c_script_9: C# additional code ----------
    class VisibleVertex
        {
        //Main attribuites
        public Mesh EnvironmentMesh;
        public Point3d AgentViewPoint;
        public double AgentViewRange;

        public List<Point3d> VisibleVertexPoints = new List<Point3d>();
        public List<Vector3d> ViewVectors = new List<Vector3d>();
        public List<int> VisibleVertexIndexes = new List<int>();
        public List<int> HighestVertexIndexes = new List<int>();
        public List<int> LowestVertexIndexes = new List<int>();


        //CONSTRUCTOR (Input mesh, agent location point, agent view height, agent view range)
        public VisibleVertex(Mesh environmentMesh, Point3d agentPoint, double viewHeight, double viewRange)
            {
            EnvironmentMesh = environmentMesh;
            agentPoint.Z += viewHeight; // to assign height to agent
            AgentViewPoint = agentPoint;
            AgentViewRange = viewRange;
            }

        //COMPUTE Function. true if visible points should be saved
        public void Compute(bool computePoints) 
            {
            
            //Boolean for final loop
            bool firstCheck = true;

            //Highest and Lowest counter
            List<double> highestVertexHeights = new List<double>();
            List<double> lowestVertexHeights = new List<double>();

            for (int i = 0; i < EnvironmentMesh.Vertices.Count; i++)
                {
                    //1. Visit the mesh vertex
                    Point3d currentVertex = EnvironmentMesh.Vertices[i];

                    //FILTER. To only operate on vectors with x, y, z ranges for robustness.
                    if (currentVertex.X < AgentViewPoint.X + AgentViewRange && currentVertex.X > AgentViewPoint.X - AgentViewRange)
                    {
                        if (currentVertex.Y < AgentViewPoint.Y + AgentViewRange && currentVertex.Y > AgentViewPoint.Y - AgentViewRange)
                        {

                            if (currentVertex.Z < AgentViewPoint.Z + AgentViewRange && currentVertex.Z > AgentViewPoint.Z - AgentViewRange)
                            {
                                //CONTINUE AFTER FILTER
                                //2. Create vector from agent position to vertex
                                Vector3d viewVector = currentVertex - AgentViewPoint;

                                //FILTER TO ONLY OPERATE ON VERTICES IN REAL RANGE OF VIEW
                                double vectorLength = viewVector.Length;
                                if (vectorLength < AgentViewRange)
                                {
                                    //3. Create ray from agent position to vertex
                                    Ray3d viewRay = new Ray3d(AgentViewPoint, viewVector);

                                    //4. Create MeshRay from ray
                                    double viewMeshRay = Rhino.Geometry.Intersect.Intersection.MeshRay(EnvironmentMesh, viewRay);

                                    //LAST, add info to lists
                                    //Check visibility = ray is hitting a visible spot, in other words, exactly or around parameter 1.0 in the MeshRay result

                                    if (viewMeshRay >= 0.99 && viewMeshRay <= 1.01)
                                    {
                                        //0. Get the index of the mesh vertex
                                        int vertexIndex = i;

                                        //X. Fill lists with visible data
                                        VisibleVertexIndexes.Add(vertexIndex);
                                        ViewVectors.Add(viewVector);
                                        
                                        if (computePoints == true)
                                            VisibleVertexPoints.Add(currentVertex);

                                        //MAIN EVALUATION - Check for highest or lowest cases
                                        if (firstCheck == true) //This will run only in the first iteration
                                            {
                                                //Turn off first check
                                                firstCheck = false;

                                                //Assign highest and lowest for the first time
                                                HighestVertexIndexes.Add(vertexIndex);
                                                highestVertexHeights.Add(currentVertex.Z);
                                                
                                                LowestVertexIndexes.Add(vertexIndex);
                                                lowestVertexHeights.Add(currentVertex.Z);
                                            }
                                            //Assign highest and lowest point and index for the remaining checks
                                            else
                                            {
                                                if (currentVertex.Z > highestVertexHeights[0])
                                                {
                                                    HighestVertexIndexes[0] = vertexIndex;
                                                    highestVertexHeights[0] = currentVertex.Z;
                                                }

                                                if (currentVertex.Z < lowestVertexHeights[0])
                                                {
                                                    LowestVertexIndexes[0] = vertexIndex;
                                                    lowestVertexHeights[0] = currentVertex.Z;
                                                }
                                            }
                                        }
                                    }
                                }
                            }
                        }
                    }
                }
            }
# ---------- end c_script_9 ----------

# ----
# Visualization
gradient = Gradient(
    LowerLimit=0,
    UpperLimit=1,
    Parameter=pt,
    stops=[0.548: RGB(132, 182, 217), 0.655: RGB(232, 230, 186), 0.757: RGB(204, 126, 112)])

conmesh = ConstructMesh(Vertices=demesh.Vertices, Faces=demesh.Faces, Colours=gradient)
wbcatmullclark = WeaverbirdsCatmullClarkSubdivision(MeshCurves=conmesh, Level=1, SmoothNakedEdges=1)

# ---- group: FINAL VISUALIZATION / Highest Point
list_item_6 = ListItem(List=demesh.Vertices, Index=c_script_9.oHighestVerticesIndex, Wrap=True)

# ---- group: FINAL VISUALIZATION / Lowest Points
list_item_7 = ListItem(List=demesh.Vertices, Index=c_script_9.oLowestVerticesIndex, Wrap=True)

# ---- group: FINAL VISUALIZATION / Agent Vision Points
list_item_8 = ListItem(List=demesh.Vertices, Index=c_script_9.oVisibleVerticesIndex, Wrap=True)

# ---- group: FINAL VISUALIZATION
closest_point = ClosestPoint(Point=list_item_6, Cloud=list_item_8)  # -> ClosestPoint, CPIndex, Distance
closest_point_2 = ClosestPoint(Point=list_item_7, Cloud=list_item_8)  # -> ClosestPoint, CPIndex, Distance

# ---- group: FINAL VISUALIZATION / Vision Points
cull_index = CullIndex(List=list_item_8, Indices=[closest_point.CPIndex, closest_point_2.CPIndex], Wrap=True)

# ---- group: FINAL VISUALIZATION / Agent Positions
point_5 = Point(c_script_9.oViewPoints)

# ---- group: FINAL VISUALIZATION
point_6 = Point(demesh.Vertices)
distance = Distance(PointA=point_5, PointB=point_6)
unit_z_2 = UnitZ(Factor=-1000)
smaller_than = SmallerThan(FirstNumber=distance, SecondNumber=viewrange)  # -> SmallerThan, OrEqualTo
mesh_5 = Mesh(conmesh)
mesh_edges = MeshEdges(Mesh=mesh_5)  # -> NakedEdges, InteriorEdges, NonManifoldEdges
extrude = Extrude(Base=mesh_edges.NakedEdges, Direction=unit_z_2)
cull_pattern = CullPattern(List=point_6, CullPattern=smaller_than.OrEqualTo)
line = Line(StartPoint=point_5, EndPoint=list_item_6)
line_2 = Line(StartPoint=point_5, EndPoint=list_item_7)
line_3 = Line(StartPoint=point_5, EndPoint=list_item_8)
line_4 = Line(StartPoint=point_5, EndPoint=cull_index)
custom_preview = CustomPreview(Geometry=extrude, Material=ColourSwatch(SwatchColor=RGB(125, 125, 125)))
custom_preview_2 = CustomPreview(Geometry=mesh_5, Material=ColourSwatch(SwatchColor=RGB(255, 255, 255)))
custom_preview_lineweights = CustomPreviewLineweights(Geometry=mesh_edges.NakedEdges, Shader=ColourSwatch(SwatchColor=RGB(64, 64, 64)), Thickness="4", Absolute=False)
custom_preview_lineweights_2 = CustomPreviewLineweights(Geometry=mesh_edges.InteriorEdges, Shader=ColourSwatch(SwatchColor=RGB(178, 178, 178)), Thickness=".5", Absolute=False)
custom_preview_lineweights_3 = CustomPreviewLineweights(Geometry=line_3, Shader=ColourSwatch(SwatchColor=RGB(255, 255, 255)), Thickness="1", Absolute=False)
custom_preview_lineweights_4 = CustomPreviewLineweights(Geometry=line_4, Shader=ColourSwatch(SwatchColor=RGB(255, 255, 255)), Thickness="1", Absolute=False)
custom_preview_lineweights_5 = CustomPreviewLineweights(Geometry=line, Shader=ColourSwatch(SwatchColor=RGB(255, 0, 0)), Thickness="2", Absolute=False)
custom_preview_lineweights_6 = CustomPreviewLineweights(Geometry=line_2, Shader=ColourSwatch(SwatchColor=RGB(0, 144, 255)), Thickness="2", Absolute=False)
list_length_3 = ListLength(List=list_item_8)
list_length_4 = ListLength(List=cull_pattern)
panel_2 = Panel(list_length_4)
panel_3 = Panel(list_length_3)
division = Division(A=panel_3, B=panel_2)
panel_4 = Panel(division)

# ---- group: FINAL VISUALIZATION / Range of view
unit_z_3 = UnitZ(Factor=100)
circle = Circle(Plane=point_5, Radius=viewrange)
move = Move(Geometry=circle, Motion=unit_z_3)  # -> Geometry, Transform
custom_preview_lineweights_7 = CustomPreviewLineweights(Geometry=move.Geometry, Shader=ColourSwatch(SwatchColor=RGB(209, 209, 209)), Thickness="2", Absolute=False)  # disabled

# ---- group: FINAL VISUALIZATION / Visualize Agents
mesh_sphere = MeshSphere(Base=point_5, Radius=Slider(10, range=0..10), UCount=10, VCount=20)
custom_preview_3 = CustomPreview(Geometry=mesh_sphere, Material=ColourSwatch(SwatchColor=RGB(99, 33, 33)))

# ---- group: FINAL VISUALIZATION / Visualize Nodes
number_slider_9 = Slider(2, range=0..10)  # disabled
mesh_sphere_2 = MeshSphere(Base=list_item_8, Radius=number_slider_9, UCount=5, VCount=10)  # disabled
colour_swatch = ColourSwatch(SwatchColor=RGB(255, 255, 255))  # disabled
custom_preview_4 = CustomPreview(Geometry=mesh_sphere_2, Material=colour_swatch)  # disabled

mesh_sphere_3 = MeshSphere(Base=cull_pattern, Radius=Slider(2.5, range=0..10), UCount=5, VCount=10)
custom_preview_5 = CustomPreview(Geometry=mesh_sphere_3, Material=ColourSwatch(SwatchColor=RGB(255, 255, 255)))

# ==== cluster Cluster
list = ClusterInput()
domain_start = ClusterInput()
domain_end = ClusterInput()
construct_domain = ConstructDomain(DomainStart=domain_start, DomainEnd=domain_end)
list_length = ListLength(List=list)
seed = ClusterInput()
random = Random(Range=construct_domain, Number=list_length, Seed=seed)
unit_z = UnitZ(Factor=random)
geometry = ClusterInput()
move = Move(Geometry=geometry, Motion=unit_z)  # -> Geometry, Transform
geometry_2 = ClusterOutput(move.Geometry)
